# Grasshopper definition test.1.gh (Grasshopper 1.0.7)
# plug-ins: ShapeDiverForGrasshopper

sddp = ShapeDiverDocumentPayload({AbsoluteTolerance=0, AngleTolerance=0, DistanceDisplayPrecision=0, GltfVersion="Gltf2", GrasshopperVersion="1.0.0007", InputGroups="{}", OutputGroups="{}", RelativeTolerance=0, RhinoVersion="7.37.24107.15001", UnitSystem=0, VersionCreated="1.26.0.0", VersionSaved="1.26.0.0"})

panel = Panel("""{
  "Roof Garden": {
    "type": "box",
    "data": {
      "plane": [[0, 0, 94.5], [1, 0, 0], [0, 1, 0]],
      "extents": [[0, 72], [0, 47], [0, 3.5]]
    }
  },
  "Roof Garden color": {
    "type": "color",
    "data": [100, 160, 100]
  }
}""")  # disabled
panel_2 = Panel("{\"Community & Social Interaction\":{\"type\":\"box\",\"data\":{\"plane\":[[0,0,14],[1,0,0],[0,1,0]],\"extents\":[[0,72],[0,47],[0,3.5]]}},\"Community & Social Interaction color\":{\"type\":\"color\",\"data\":[147,79,128]}}")  # disabled
panel_3 = Panel("{\"Elderly Independent\":{\"type\":\"box\",\"data\":{\"plane\":[[0,0,0],[1,0,0],[0,1,0]],\"extents\":[[0,72],[0,47],[0,28]]}},\"Elderly Independent color\":{\"type\":\"color\",\"data\":[255,236,139]},\"start level_Elderly Independent\":17.5,\"floors_Elderly Independent\":8,\"Elderly Assisted\":{\"type\":\"box\",\"data\":{\"plane\":[[0,0,0],[1,0,0],[0,1,0]],\"extents\":[[0,72],[0,47],[0,28]]}},\"Elderly Assisted color\":{\"type\":\"color\",\"data\":[255,191,0]},\"start level_Elderly Assisted\":45.5,\"floors_Elderly Assisted\":6,\"Hotel\":{\"type\":\"box\",\"data\":{\"plane\":[[0,0,0],[1,0,0],[0,1,0]],\"extents\":[[0,72],[0,47],[0,10.5]]}},\"Hotel color\":{\"type\":\"color\",\"data\":[255,140,0]},\"start level_Hotel\":66.5,\"floors_Hotel\":3}")  # disabled
parse_json = ParseJSON(JSON=panel)  # disabled
panel_4 = Panel("Roof Garden color")  # disabled
parse_json_2 = ParseJSON(JSON=panel_2)  # disabled
panel_5 = Panel("Roof Garden")  # disabled
panel_6 = Panel("Community & Social Interaction color")  # disabled
parse_json_3 = ParseJSON(JSON=panel_3)  # disabled
panel_7 = Panel("floors_Elderly Assisted")  # disabled
panel_8 = Panel("Community & Social Interaction")  # disabled
panel_9 = Panel("floors_Elderly Independent")  # disabled
panel_10 = Panel("start level_Elderly Assisted")  # disabled
panel_11 = Panel("start level_Elderly Independent")  # disabled
panel_12 = Panel("Elderly Assisted color")  # disabled
panel_13 = Panel("Elderly Independent color")  # disabled
panel_14 = Panel("Elderly Assisted")  # disabled
panel_15 = Panel("Elderly Independent")  # disabled
access_json = AccessJSON(Object=parse_json, AddressString=panel_5)  # disabled
access_json_2 = AccessJSON(Object=parse_json_2, AddressString=panel_8)  # disabled
access_json_3 = AccessJSON(Object=parse_json, AddressString=panel_4)  # disabled
access_json_4 = AccessJSON(Object=parse_json_2, AddressString=panel_6)  # disabled
convert_json = ConvertJSON(Object=access_json_3)  # disabled
convert_json_2 = ConvertJSON(Object=access_json_4)  # disabled
cluster = Cluster(
    object_2=parse_json_3,
    addressstring_3=panel_14,
    object_4=parse_json_3,
    addressstring_4=panel_12,
    object=parse_json_3,
    addressstring=panel_10,
    object_3=parse_json_3,
    addressstring_2=panel_7)  # -> geometry, converted; disabled
cluster_2 = Cluster(
    object_2=parse_json_3,
    addressstring_3=panel_15,
    object_4=parse_json_3,
    addressstring_4=panel_13,
    object=parse_json_3,
    addressstring=panel_11,
    object_3=parse_json_3,
    addressstring_2=panel_9)  # -> geometry, converted; disabled
convert_json_3 = ConvertJSON(Object=access_json)  # disabled
convert_json_4 = ConvertJSON(Object=access_json_2)  # disabled
custom_preview = CustomPreview(Geometry=convert_json_4, Material=convert_json_2)  # disabled
custom_preview_2 = CustomPreview(Geometry=convert_json_3, Material=convert_json)  # disabled
custom_preview_3 = CustomPreview(Geometry=cluster.geometry, Material=cluster.converted)  # disabled
custom_preview_4 = CustomPreview(Geometry=cluster_2.geometry, Material=cluster_2.converted)  # disabled

panel_16 = Panel("{\"Elderly Independent\":{\"type\":\"box\",\"data\":{\"plane\":[[0,0,0],[1,0,0],[0,1,0]],\"extents\":[[0,72],[0,47],[0,3.5]]}},\"Elderly Independent_color\":{\"type\":\"color\",\"data\":[255,236,139]},\"Elderly Independent_start level\":10.5,\"Elderly Independent_floors\":8,\"Elderly Assisted\":{\"type\":\"box\",\"data\":{\"plane\":[[0,0,0],[1,0,0],[0,1,0]],\"extents\":[[0,72],[0,47],[0,3.5]]}},\"Elderly Assisted_color\":{\"type\":\"color\",\"data\":[255,191,0]},\"Elderly Assisted_start level\":38.5,\"Elderly Assisted_floors\":6,\"Hotel\":{\"type\":\"box\",\"data\":{\"plane\":[[0,0,0],[1,0,0],[0,1,0]],\"extents\":[[0,72],[0,47],[0,3.5]]}},\"Hotel_color\":{\"type\":\"color\",\"data\":[255,140,0]},\"Hotel_start level\":59.5,\"Hotel_floors\":3,\"Roof Garden\":{\"type\":\"box\",\"data\":{\"plane\":[[0,0,0],[1,0,0],[0,1,0]],\"extents\":[[0,72],[0,47],[0,3.5]]}},\"Roof Garden_color\":{\"type\":\"color\",\"data\":[100,160,100]},\"Roof Garden_start level\":70,\"Roof Garden_floors\":1,\"Community & Social\":{\"type\":\"box\",\"data\":{\"plane\":[[0,0,0],[1,0,0],[0,1,0]],\"extents\":[[0,72],[0,47],[0,3.5]]}},\"Community & Social_color\":{\"type\":\"color\",\"data\":[147,79,128]},\"Community & Social_start level\":7,\"Community & Social_floors\":1,\"Daycare & Rehab\":{\"type\":\"box\",\"data\":{\"plane\":[[0,0,0],[1,0,0],[0,1,0]],\"extents\":[[0,72],[0,47],[0,3.5]]}},\"Daycare & Rehab_color\":{\"type\":\"color\",\"data\":[190,130,190]},\"Daycare & Rehab_start level\":3.5,\"Daycare & Rehab_floors\":2,\"Lobby & Commercial\":{\"type\":\"box\",\"data\":{\"plane\":[[0,0,0],[1,0,0],[0,1,0]],\"extents\":[[0,72],[0,47],[0,3.5]]}},\"Lobby & Commercial_color\":{\"type\":\"color\",\"data\":[160,200,120]},\"Lobby & Commercial_start level\":0,\"Lobby & Commercial_floors\":1,\"Retail & Support\":{\"type\":\"box\",\"data\":{\"plane\":[[0,0,0],[1,0,0],[0,1,0]],\"extents\":[[0,72],[0,47],[0,3.5]]}},\"Retail & Support_color\":{\"type\":\"color\",\"data\":[100, 160, 220]},\"Retail & Support_start level\":-3.5,\"Retail & Support_floors\":1,\"Parking & MEP\":{\"type\":\"box\",\"data\":{\"plane\":[[0,0,0],[1,0,0],[0,1,0]],\"extents\":[[0,72],[0,47],[0,3.5]]}},\"Parking & MEP_color\":{\"type\":\"color\",\"data\":[130,130,130]},\"Parking & MEP_start level\":-17.5,\"Parking & MEP_floors\":4}")
massing = Massing(
    json=panel_16,
    addressstring="Retail & Support",
    fragment_a="Retail & Support",
    fragment_a_2="Retail & Support",
    fragment_a_3="Retail & Support")  # -> geometry, converted
massing_2 = Massing(
    json=panel_16,
    addressstring="Parking & MEP",
    fragment_a="Parking & MEP",
    fragment_a_2="Parking & MEP",
    fragment_a_3="Parking & MEP")  # -> geometry, converted
massing_3 = Massing(
    json=panel_16,
    addressstring="Community & Social",
    fragment_a="Community & Social",
    fragment_a_2="Community & Social",
    fragment_a_3="Community & Social")  # -> geometry, converted
massing_4 = Massing(
    json=panel_16,
    addressstring="Daycare & Rehab",
    fragment_a="Daycare & Rehab",
    fragment_a_2="Daycare & Rehab",
    fragment_a_3="Daycare & Rehab")  # -> geometry, converted
massing_5 = Massing(
    json=panel_16,
    addressstring="Lobby & Commercial",
    fragment_a="Lobby & Commercial",
    fragment_a_2="Lobby & Commercial",
    fragment_a_3="Lobby & Commercial")  # -> geometry, converted
massing_6 = Massing(
    json=panel_16,
    addressstring="Roof Garden",
    fragment_a="Roof Garden",
    fragment_a_2="Roof Garden",
    fragment_a_3="Roof Garden")  # -> geometry, converted
massing_7 = Massing(json=panel_16, addressstring="Hotel", fragment_a="Hotel", fragment_a_2="Hotel", fragment_a_3="Hotel")  # -> geometry, converted
massing_8 = Massing(
    json=panel_16,
    addressstring="Elderly Assisted",
    fragment_a="Elderly Assisted",
    fragment_a_2="Elderly Assisted",
    fragment_a_3="Elderly Assisted")  # -> geometry, converted
massing_9 = Massing(
    json=panel_16,
    addressstring="Elderly Independent",
    fragment_a="Elderly Independent",
    fragment_a_2="Elderly Independent",
    fragment_a_3="Elderly Independent")  # -> geometry, converted
custom_preview_5 = CustomPreview(Geometry=massing.geometry, Material=massing.converted)
custom_preview_6 = CustomPreview(Geometry=massing_2.geometry, Material=massing_2.converted)
custom_preview_7 = CustomPreview(Geometry=massing_3.geometry, Material=massing_3.converted)
custom_preview_8 = CustomPreview(Geometry=massing_4.geometry, Material=massing_4.converted)
custom_preview_9 = CustomPreview(Geometry=massing_5.geometry, Material=massing_5.converted)
custom_preview_10 = CustomPreview(Geometry=massing_7.geometry, Material=massing_7.converted)
custom_preview_11 = CustomPreview(Geometry=massing_6.geometry, Material=massing_6.converted)
custom_preview_12 = CustomPreview(Geometry=massing_8.geometry, Material=massing_8.converted)
custom_preview_13 = CustomPreview(Geometry=massing_9.geometry, Material=massing_9.converted)
panel_17 = Panel("{\"Parking & MEP\":{\"type\":\"box\",\"data\":{\"plane\":[[100,0,0],[1,0,0],[0,1,0]],\"extents\":[[0,72],[0,47],[0,3.5]]}},\"Parking & MEP_color\":{\"type\":\"color\",\"data\":[130,130,130]},\"Parking & MEP_start level\":-17.5,\"Parking & MEP_floors\":4,\"Retail & Support\":{\"type\":\"box\",\"data\":{\"plane\":[[100,0,0],[1,0,0],[0,1,0]],\"extents\":[[0,72],[0,47],[0,3.5]]}},\"Retail & Support_color\":{\"type\":\"color\",\"data\":[100,160,220]},\"Retail & Support_start level\":-3.5,\"Retail & Support_floors\":1,\"Restaurant\":{\"type\":\"box\",\"data\":{\"plane\":[[100,0,0],[1,0,0],[0,1,0]],\"extents\":[[0,72],[0,47],[0,3.5]]}},\"Restaurant_color\":{\"type\":\"color\",\"data\":[20,60,120]},\"Restaurant_start level\":0,\"Restaurant_floors\":1,\"Café\":{\"type\":\"box\",\"data\":{\"plane\":[[100,0,0],[1,0,0],[0,1,0]],\"extents\":[[0,72],[0,47],[0,3.5]]}},\"Café_color\":{\"type\":\"color\",\"data\":[20,60,120]},\"Café_start level\":3.5,\"Café_floors\":1,\"Daycare & Rehab\":{\"type\":\"box\",\"data\":{\"plane\":[[100,0,0],[1,0,0],[0,1,0]],\"extents\":[[0,72],[0,47],[0,3.5]]}},\"Daycare & Rehab_color\":{\"type\":\"color\",\"data\":[190,130,190]},\"Daycare & Rehab_start level\":7,\"Daycare & Rehab_floors\":1,\"Community & Social\":{\"type\":\"box\",\"data\":{\"plane\":[[100,0,0],[1,0,0],[0,1,0]],\"extents\":[[0,72],[0,47],[0,3.5]]}},\"Community & Social_color\":{\"type\":\"color\",\"data\":[147,79,128]},\"Community & Social_start level\":10.5,\"Community & Social_floors\":1,\"Elderly Independent\":{\"type\":\"box\",\"data\":{\"plane\":[[100,0,0],[1,0,0],[0,1,0]],\"extents\":[[0,72],[0,47],[0,3.5]]}},\"Elderly Independent_color\":{\"type\":\"color\",\"data\":[255,236,139]},\"Elderly Independent_start level\":14,\"Elderly Independent_floors\":11,\"Elderly Assisted\":{\"type\":\"box\",\"data\":{\"plane\":[[100,0,0],[1,0,0],[0,1,0]],\"extents\":[[0,72],[0,47],[0,3.5]]}},\"Elderly Assisted_color\":{\"type\":\"color\",\"data\":[255,191,0]},\"Elderly Assisted_start level\":52.5,\"Elderly Assisted_floors\":4,\"Hotel\":{\"type\":\"box\",\"data\":{\"plane\":[[100,0,0],[1,0,0],[0,1,0]],\"extents\":[[0,72],[0,47],[0,3.5]]}},\"Hotel_color\":{\"type\":\"color\",\"data\":[255,140,0]},\"Hotel_start level\":66.5,\"Hotel_floors\":1,\"Roof Garden\":{\"type\":\"box\",\"data\":{\"plane\":[[100,0,0],[1,0,0],[0,1,0]],\"extents\":[[0,72],[0,47],[0,3.5]]}},\"Roof Garden_color\":{\"type\":\"color\",\"data\":[100,160,100]},\"Roof Garden_start level\":70,\"Roof Garden_floors\":1}")
massing_10 = Massing(
    json=panel_17,
    addressstring="Community & Social",
    fragment_a="Community & Social",
    fragment_a_2="Community & Social",
    fragment_a_3="Community & Social")  # -> geometry, converted
massing_11 = Massing(
    json=panel_17,
    addressstring="Daycare & Rehab",
    fragment_a="Daycare & Rehab",
    fragment_a_2="Daycare & Rehab",
    fragment_a_3="Daycare & Rehab")  # -> geometry, converted
massing_12 = Massing(json=panel_17, addressstring="Café", fragment_a="Café", fragment_a_2="Café", fragment_a_3="Café")  # -> geometry, converted
massing_13 = Massing(
    json=panel_17,
    addressstring="Roof Garden",
    fragment_a="Roof Garden",
    fragment_a_2="Roof Garden",
    fragment_a_3="Roof Garden")  # -> geometry, converted
massing_14 = Massing(json=panel_17, addressstring="Hotel", fragment_a="Hotel", fragment_a_2="Hotel", fragment_a_3="Hotel")  # -> geometry, converted
massing_15 = Massing(json=panel_17, addressstring="Restaurant", fragment_a="Restaurant", fragment_a_2="Restaurant", fragment_a_3="Restaurant")  # -> geometry, converted
massing_16 = Massing(
    json=panel_17,
    addressstring="Elderly Assisted",
    fragment_a="Elderly Assisted",
    fragment_a_2="Elderly Assisted",
    fragment_a_3="Elderly Assisted")  # -> geometry, converted
massing_17 = Massing(
    json=panel_17,
    addressstring="Elderly Independent",
    fragment_a="Elderly Independent",
    fragment_a_2="Elderly Independent",
    fragment_a_3="Elderly Independent")  # -> geometry, converted
massing_18 = Massing(
    json=panel_17,
    addressstring="Retail & Support",
    fragment_a="Retail & Support",
    fragment_a_2="Retail & Support",
    fragment_a_3="Retail & Support")  # -> geometry, converted
massing_19 = Massing(
    json=panel_17,
    addressstring="Parking & MEP",
    fragment_a="Parking & MEP",
    fragment_a_2="Parking & MEP",
    fragment_a_3="Parking & MEP")  # -> geometry, converted
massing_20 = Massing(
    json=panel_17,
    addressstring="Lobby & Commercial",
    fragment_a="Lobby & Commercial",
    fragment_a_2="Lobby & Commercial",
    fragment_a_3="Lobby & Commercial")  # -> geometry, converted
custom_preview_14 = CustomPreview(Geometry=massing_10.geometry, Material=massing_10.converted)
custom_preview_15 = CustomPreview(Geometry=massing_11.geometry, Material=massing_11.converted)
custom_preview_16 = CustomPreview(Geometry=massing_12.geometry, Material=massing_12.converted)
custom_preview_17 = CustomPreview(Geometry=massing_14.geometry, Material=massing_14.converted)
custom_preview_18 = CustomPreview(Geometry=massing_15.geometry, Material=massing_15.converted)
custom_preview_19 = CustomPreview(Geometry=massing_13.geometry, Material=massing_13.converted)
custom_preview_20 = CustomPreview(Geometry=massing_16.geometry, Material=massing_16.converted)
custom_preview_21 = CustomPreview(Geometry=massing_17.geometry, Material=massing_17.converted)
custom_preview_22 = CustomPreview(Geometry=massing_18.geometry, Material=massing_18.converted)
custom_preview_23 = CustomPreview(Geometry=massing_19.geometry, Material=massing_19.converted)
custom_preview_24 = CustomPreview(Geometry=massing_20.geometry, Material=massing_20.converted)
panel_18 = Panel("{\"Parking & MEP\":{\"type\":\"box\",\"data\":{\"plane\":[[200,0,0],[1,0,0],[0,1,0]],\"extents\":[[0,72],[0,47],[0,3.5]]}},\"Parking & MEP_color\":{\"type\":\"color\",\"data\":[130,130,130]},\"Parking & MEP_start level\":-17.5,\"Parking & MEP_floors\":5,\"Restaurant\":{\"type\":\"box\",\"data\":{\"plane\":[[200,0,0],[1,0,0],[0,1,0]],\"extents\":[[0,72],[0,47],[0,3.5]]}},\"Restaurant_color\":{\"type\":\"color\",\"data\":[20,60,120]},\"Restaurant_start level\":0,\"Restaurant_floors\":1,\"Retail & Support\":{\"type\":\"box\",\"data\":{\"plane\":[[200,0,0],[1,0,0],[0,1,0]],\"extents\":[[0,72],[0,47],[0,3.5]]}},\"Retail & Support_color\":{\"type\":\"color\",\"data\":[100,160,220]},\"Retail & Support_start level\":3.5,\"Retail & Support_floors\":1,\"Daycare & Rehab\":{\"type\":\"box\",\"data\":{\"plane\":[[200,0,0],[1,0,0],[0,1,0]],\"extents\":[[0,72],[0,47],[0,3.5]]}},\"Daycare & Rehab_color\":{\"type\":\"color\",\"data\":[190,130,190]},\"Daycare & Rehab_start level\":7,\"Daycare & Rehab_floors\":1,\"Community & Social\":{\"type\":\"box\",\"data\":{\"plane\":[[200,0,0],[1,0,0],[0,1,0]],\"extents\":[[0,72],[0,47],[0,3.5]]}},\"Community & Social_color\":{\"type\":\"color\",\"data\":[147,79,128]},\"Community & Social_start level\":10.5,\"Community & Social_floors\":4,\"Elderly Independent\":{\"type\":\"box\",\"data\":{\"plane\":[[200,0,0],[1,0,0],[0,1,0]],\"extents\":[[0,72],[0,47],[0,3.5]]}},\"Elderly Independent_color\":{\"type\":\"color\",\"data\":[255,236,139]},\"Elderly Independent_start level\":24.5,\"Elderly Independent_floors\":7,\"Elderly Assisted\":{\"type\":\"box\",\"data\":{\"plane\":[[200,0,0],[1,0,0],[0,1,0]],\"extents\":[[0,72],[0,47],[0,3.5]]}},\"Elderly Assisted_color\":{\"type\":\"color\",\"data\":[255,191,0]},\"Elderly Assisted_start level\":49,\"Elderly Assisted_floors\":2,\"Hotel\":{\"type\":\"box\",\"data\":{\"plane\":[[200,0,0],[1,0,0],[0,1,0]],\"extents\":[[0,72],[0,47],[0,3.5]]}},\"Hotel_color\":{\"type\":\"color\",\"data\":[255,140,0]},\"Hotel_start level\":56,\"Hotel_floors\":4,\"Roof Garden\":{\"type\":\"box\",\"data\":{\"plane\":[[200,0,0],[1,0,0],[0,1,0]],\"extents\":[[0,72],[0,47],[0,3.5]]}},\"Roof Garden_color\":{\"type\":\"color\",\"data\":[100,160,100]},\"Roof Garden_start level\":70,\"Roof Garden_floors\":1}")
massing_21 = Massing(
    json=panel_18,
    addressstring="Community & Social",
    fragment_a="Community & Social",
    fragment_a_2="Community & Social",
    fragment_a_3="Community & Social")  # -> geometry, converted
massing_22 = Massing(
    json=panel_18,
    addressstring="Daycare & Rehab",
    fragment_a="Daycare & Rehab",
    fragment_a_2="Daycare & Rehab",
    fragment_a_3="Daycare & Rehab")  # -> geometry, converted
massing_23 = Massing(
    json=panel_18,
    addressstring="Roof Garden",
    fragment_a="Roof Garden",
    fragment_a_2="Roof Garden",
    fragment_a_3="Roof Garden")  # -> geometry, converted
massing_24 = Massing(json=panel_18, addressstring="Hotel", fragment_a="Hotel", fragment_a_2="Hotel", fragment_a_3="Hotel")  # -> geometry, converted
massing_25 = Massing(json=panel_18, addressstring="Restaurant", fragment_a="Restaurant", fragment_a_2="Restaurant", fragment_a_3="Restaurant")  # -> geometry, converted
massing_26 = Massing(
    json=panel_18,
    addressstring="Elderly Assisted",
    fragment_a="Elderly Assisted",
    fragment_a_2="Elderly Assisted",
    fragment_a_3="Elderly Assisted")  # -> geometry, converted
massing_27 = Massing(
    json=panel_18,
    addressstring="Elderly Independent",
    fragment_a="Elderly Independent",
    fragment_a_2="Elderly Independent",
    fragment_a_3="Elderly Independent")  # -> geometry, converted
massing_28 = Massing(
    json=panel_18,
    addressstring="Retail & Support",
    fragment_a="Retail & Support",
    fragment_a_2="Retail & Support",
    fragment_a_3="Retail & Support")  # -> geometry, converted
massing_29 = Massing(
    json=panel_18,
    addressstring="Parking & MEP",
    fragment_a="Parking & MEP",
    fragment_a_2="Parking & MEP",
    fragment_a_3="Parking & MEP")  # -> geometry, converted
massing_30 = Massing(
    json=panel_18,
    addressstring="Lobby & Commercial",
    fragment_a="Lobby & Commercial",
    fragment_a_2="Lobby & Commercial",
    fragment_a_3="Lobby & Commercial")  # -> geometry, converted
custom_preview_25 = CustomPreview(Geometry=massing_21.geometry, Material=massing_21.converted)
custom_preview_26 = CustomPreview(Geometry=massing_22.geometry, Material=massing_22.converted)
custom_preview_27 = CustomPreview(Geometry=massing_24.geometry, Material=massing_24.converted)
custom_preview_28 = CustomPreview(Geometry=massing_25.geometry, Material=massing_25.converted)
custom_preview_29 = CustomPreview(Geometry=massing_23.geometry, Material=massing_23.converted)
custom_preview_30 = CustomPreview(Geometry=massing_26.geometry, Material=massing_26.converted)
custom_preview_31 = CustomPreview(Geometry=massing_27.geometry, Material=massing_27.converted)
custom_preview_32 = CustomPreview(Geometry=massing_28.geometry, Material=massing_28.converted)
custom_preview_33 = CustomPreview(Geometry=massing_29.geometry, Material=massing_29.converted)
custom_preview_34 = CustomPreview(Geometry=massing_30.geometry, Material=massing_30.converted)

# ==== cluster Cluster
addressstring = ClusterInput()
object = ClusterInput()
addressstring_2 = ClusterInput()
object_2 = ClusterInput()
addressstring_3 = ClusterInput()
object_3 = ClusterInput()
object_4 = ClusterInput()
addressstring_4 = ClusterInput()
access_json = AccessJSON(Object=object, AddressString=addressstring)
access_json_2 = AccessJSON(Object=object_2, AddressString=addressstring_3)
access_json_3 = AccessJSON(Object=object_3, AddressString=addressstring_2)
access_json_4 = AccessJSON(Object=object_4, AddressString=addressstring_4)
series = Series(Start=access_json, Step="3.5", Count=access_json_3)
convert_json = ConvertJSON(Object=access_json_2)
convert_json_2 = ConvertJSON(Object=access_json_4)
unit_z = UnitZ(Factor=series)
converted = ClusterOutput(convert_json_2)
move = Move(Geometry=convert_json, Motion=unit_z)  # -> Geometry, Transform
geometry = ClusterOutput(move.Geometry)

# ==== cluster Massing
json = ClusterInput()
fragment_a = ClusterInput()
fragment_a_2 = ClusterInput()
fragment_a_3 = ClusterInput()
parse_json = ParseJSON(JSON=json)
concatenate = Concatenate(FragmentA=fragment_a, FragmentB="_color")
concatenate_2 = Concatenate(FragmentA=fragment_a_2, FragmentB="_start level")
concatenate_3 = Concatenate(FragmentA=fragment_a_3, FragmentB="_floors")
addressstring = ClusterInput()
access_json = AccessJSON(Object=parse_json, AddressString=addressstring)
access_json_2 = AccessJSON(Object=parse_json, AddressString=concatenate)
access_json_3 = AccessJSON(Object=parse_json, AddressString=concatenate_2)
access_json_4 = AccessJSON(Object=parse_json, AddressString=concatenate_3)
series = Series(Start=access_json_3, Step="3.5", Count=access_json_4)
convert_json = ConvertJSON(Object=access_json_2)
convert_json_2 = ConvertJSON(Object=access_json)
unit_z = UnitZ(Factor=series)
converted = ClusterOutput(convert_json)
move = Move(Geometry=convert_json_2, Motion=unit_z)  # -> Geometry, Transform
geometry = ClusterOutput(move.Geometry)
