# Grasshopper definition test.2.gh (Grasshopper 1.0.7)
# plug-ins: ShapeDiverForGrasshopper

panel = Panel("outline")  # disabled
curve = Curve(<curve referenced from the Rhino model>)  # disabled
construct_json = ConstructJSON(Data=curve, AddressString=panel)  # disabled
panel_2 = Panel("courtyard_outline")  # disabled
curve_2 = Curve(<curve referenced from the Rhino model>)  # disabled
construct_json_2 = ConstructJSON(Object=construct_json, Data=curve_2, AddressString=panel_2)  # disabled
panel_3 = Panel("S3 Area")  # disabled
curve_3 = Curve(<curve referenced from the Rhino model>)  # disabled
convert_json = ConvertJSON(Object=construct_json_2)  # disabled
panel_4 = Panel("LL-S")  # disabled
curve_4 = Curve(<curve referenced from the Rhino model>)  # disabled
construct_json_3 = ConstructJSON(Object=convert_json, Data=curve_4, AddressString=panel_4)  # disabled
panel_5 = Panel("LL-W")  # disabled
curve_5 = Curve(<curve referenced from the Rhino model>)  # disabled
curve_6 = Curve(<curve referenced from the Rhino model>)  # disabled
panel_6 = Panel("LL-E")  # disabled
panel_7 = Panel("SW Area")  # disabled
panel_8 = Panel("S2 Area")  # disabled
panel_9 = Panel("W2 Area")  # disabled
panel_10 = Panel("NE Area")  # disabled
panel_11 = Panel("E2 Area")  # disabled
panel_12 = Panel("E3 Area")  # disabled
panel_13 = Panel("NW Area")  # disabled
curve_7 = Curve(<curve referenced from the Rhino model>)  # disabled
curve_8 = Curve(<curve referenced from the Rhino model>)  # disabled
curve_9 = Curve(<curve referenced from the Rhino model>)  # disabled
curve_10 = Curve(<curve referenced from the Rhino model>)  # disabled
curve_11 = Curve(<curve referenced from the Rhino model>)  # disabled
curve_12 = Curve(<curve referenced from the Rhino model>)  # disabled
curve_13 = Curve(<curve referenced from the Rhino model>)  # disabled
panel_14 = Panel("BL-W example")  # disabled
construct_json_4 = ConstructJSON(Object=construct_json_3, Data=curve_5, AddressString=panel_5)  # disabled
curve_14 = Curve(<curve referenced from the Rhino model>)  # disabled
construct_json_5 = ConstructJSON(Data=curve_12, AddressString=panel_13)  # disabled
construct_json_6 = ConstructJSON(Object=construct_json_5, Data=curve_9, AddressString=panel_9)  # disabled
construct_json_7 = ConstructJSON(Object=construct_json_6, Data=curve_7, AddressString=panel_7)  # disabled
construct_json_8 = ConstructJSON(Object=construct_json_7, Data=curve_8, AddressString=panel_8)  # disabled
construct_json_9 = ConstructJSON(Object=construct_json_8, Data=curve_3, AddressString=panel_3)  # disabled
construct_json_10 = ConstructJSON(Object=construct_json_9, Data=curve_10, AddressString=panel_10)  # disabled
construct_json_11 = ConstructJSON(Object=construct_json_10, Data=curve_11, AddressString=panel_11)  # disabled
construct_json_12 = ConstructJSON(Object=construct_json_11, Data=curve_13, AddressString=panel_12)  # disabled
panel_15 = Panel("BL-N example")  # disabled
panel_16 = Panel("BL-E example")  # disabled
panel_17 = Panel("BL-S example")  # disabled
construct_json_13 = ConstructJSON(Object=construct_json_4, Data=curve_6, AddressString=panel_6)  # disabled
curve_15 = Curve(<curve referenced from the Rhino model>)  # disabled
curve_16 = Curve(<curve referenced from the Rhino model>)  # disabled
curve_17 = Curve(<curve referenced from the Rhino model>)  # disabled
curve_18 = Curve(<curve referenced from the Rhino model>)  # disabled
panel_18 = Panel("CORE")  # disabled
construct_json_14 = ConstructJSON(Object=construct_json_13, Data=curve_18, AddressString=panel_18)  # disabled
construct_json_15 = ConstructJSON(Object=construct_json_14, Data=curve_14, AddressString=panel_14)  # disabled
construct_json_16 = ConstructJSON(Object=construct_json_15, Data=curve_16, AddressString=panel_16)  # disabled
construct_json_17 = ConstructJSON(Object=construct_json_16, Data=curve_15, AddressString=panel_17)  # disabled
construct_json_18 = ConstructJSON(Object=construct_json_17, Data=curve_17, AddressString=panel_15)  # disabled
panel_19 = Panel(construct_json_12)  # disabled
panel_20 = Panel(construct_json_18)  # disabled
sddp = ShapeDiverDocumentPayload({AbsoluteTolerance=0, AngleTolerance=0, DistanceDisplayPrecision=0, GltfVersion="Gltf2", GrasshopperVersion="1.0.0007", InputGroups="{}", OutputGroups="{}", RelativeTolerance=0, RhinoVersion="7.37.24107.15001", UnitSystem=0, VersionCreated="1.26.0.0", VersionSaved="1.26.0.0"})
file_path = FilePath("C:\python\auto_zone_layout.json")  # disabled
import_text = ImportText(
    URI=file_path,
    maximum_file_size=52428800,
    selected_file_formats="application/json,application/xml,application/x-step,text/csv,text/plain")  # -> Text, Filename; disabled
direct_text_input = DirectTextInput(maxlength=10000, text="Default")  # disabled
panel_21 = Panel(import_text.Text)  # disabled
panel_22 = Panel("W3")  # disabled
panel_23 = Panel("W4")  # disabled
panel_24 = Panel("W2")  # disabled
panel_25 = Panel("C1_2")  # disabled
panel_26 = Panel("S2")  # disabled
panel_27 = Panel("SW")  # disabled
panel_28 = Panel("S3")  # disabled
panel_29 = Panel("S4")  # disabled
panel_30 = Panel("E3")  # disabled
panel_31 = Panel("E4")  # disabled
panel_32 = Panel("C1")  # disabled
panel_33 = Panel("C3_2")  # disabled
panel_34 = Panel("E4_2")  # disabled
panel_35 = Panel("OS")  # disabled
panel_36 = Panel("C3")  # disabled
panel_37 = Panel("C1_2")  # disabled
panel_38 = Panel("N2")  # disabled
cluster = Cluster(text=panel_25)  # -> converted_2, converted, center_2, function; disabled
cluster_2 = Cluster(json=panel_21, text=panel_23)  # -> converted_2, converted, center_2, function; disabled
cluster_3 = Cluster(json=panel_21, text=panel_22)  # -> converted_2, converted, center_2, function; disabled
cluster_4 = Cluster(json=panel_21, text=panel_28)  # -> converted_2, converted, center_2, function; disabled
cluster_5 = Cluster(json=panel_21, text=panel_24)  # -> converted_2, converted, center_2, function; disabled
cluster_6 = Cluster(json=panel_21, text=panel_29)  # -> converted_2, converted, center_2, function; disabled
cluster_7 = Cluster(json=panel_21, text=panel_30)  # -> converted_2, converted, center_2, function; disabled
cluster_8 = Cluster(json=panel_21, text=panel_36)  # -> converted_2, converted, center_2, function; disabled
cluster_9 = Cluster(json=panel_21, text=panel_27)  # -> converted_2, converted, center_2, function; disabled
cluster_10 = Cluster(json=panel_21, text=panel_33)  # -> converted_2, converted, center_2, function; disabled
cluster_11 = Cluster(json=panel_21, text=panel_31)  # -> converted_2, converted, center_2, function; disabled
cluster_12 = Cluster(json=panel_21, text=panel_32)  # -> converted_2, converted, center_2, function; disabled
cluster_13 = Cluster(json=panel_21, text=panel_26)  # -> converted_2, converted, center_2, function; disabled
cluster_14 = Cluster(json=panel_21, text=panel_35)  # -> converted_2, converted, center_2, function; disabled
cluster_15 = Cluster(json=panel_21, text=panel_34)  # -> converted_2, converted, center_2, function; disabled
cluster_16 = Cluster(json=panel_21, text=panel_37)  # -> converted_2, converted, center_2, function; disabled
cluster_17 = Cluster(json=panel_21, text=panel_38)  # -> converted_2, converted, center_2, function; disabled
custom_preview = CustomPreview(Geometry=cluster_2.converted_2, Material=cluster_2.converted)  # disabled
custom_preview_2 = CustomPreview(Geometry=cluster_13.converted_2, Material=cluster_13.converted)  # disabled
custom_preview_3 = CustomPreview(Geometry=cluster_3.converted_2, Material=cluster_3.converted)  # disabled
custom_preview_4 = CustomPreview(Geometry=cluster_4.converted_2, Material=cluster_4.converted)  # disabled
custom_preview_5 = CustomPreview(Geometry=cluster_6.converted_2, Material=cluster_6.converted)  # disabled
custom_preview_6 = CustomPreview(Geometry=cluster_7.converted_2, Material=cluster_7.converted)  # disabled
custom_preview_7 = CustomPreview(Geometry=cluster_8.converted_2, Material=cluster_8.converted)  # disabled
custom_preview_8 = CustomPreview(Geometry=cluster_5.converted_2, Material=cluster_5.converted)  # disabled
custom_preview_9 = CustomPreview(Geometry=cluster_10.converted_2, Material=cluster_10.converted)  # disabled
custom_preview_10 = CustomPreview(Geometry=cluster_11.converted_2, Material=cluster_11.converted)  # disabled
custom_preview_11 = CustomPreview(Geometry=cluster_12.converted_2, Material=cluster_12.converted)  # disabled
custom_preview_12 = CustomPreview(Geometry=cluster_14.converted_2, Material=cluster_14.converted)  # disabled
custom_preview_13 = CustomPreview(Geometry=cluster_15.converted_2, Material=cluster_15.converted)  # disabled
custom_preview_14 = CustomPreview(Geometry=cluster_16.converted_2, Material=cluster_16.converted)  # disabled
custom_preview_15 = CustomPreview(Geometry=cluster_17.converted_2, Material=cluster_17.converted)  # disabled
custom_preview_16 = CustomPreview(Geometry=cluster.converted_2, Material=cluster.converted)  # disabled
custom_preview_17 = CustomPreview(Geometry=cluster_9.converted_2, Material=cluster_9.converted)  # disabled
text_tag = TextTag(Location=cluster_5.center_2, Text=cluster_5.function, Colour=RGB(0, 0, 0))  # disabled
text_tag_2 = TextTag(Location=cluster_3.center_2, Text=cluster_3.function)  # disabled
text_tag_3 = TextTag(Location=cluster_14.center_2, Text=cluster_14.function, Colour=RGB(0, 0, 0))  # disabled
text_tag_4 = TextTag(Location=cluster_17.center_2, Text=cluster_17.function, Colour=RGB(0, 0, 0))  # disabled
text_tag_5 = TextTag(Location=cluster_16.center_2, Text=cluster_16.function, Colour=RGB(0, 0, 0))  # disabled
text_tag_6 = TextTag(Location=cluster.center_2, Text=cluster.function, Colour=RGB(0, 0, 0))  # disabled
text_tag_7 = TextTag(Location=cluster_8.center_2, Text=cluster_8.function, Colour=RGB(0, 0, 0))  # disabled
text_tag_8 = TextTag(Location=cluster_5.center_2, Text=cluster_2.center_2, Colour=cluster_2.function)  # disabled
text_tag_9 = TextTag(Location=cluster_12.center_2, Text=cluster_12.function, Colour=RGB(0, 0, 0))  # disabled
text_tag_10 = TextTag(Location=cluster_4.center_2, Text=cluster_4.function, Colour=RGB(0, 0, 0))  # disabled
text_tag_11 = TextTag(Location=cluster_10.center_2, Text=cluster_10.function, Colour=RGB(0, 0, 0))  # disabled
text_tag_12 = TextTag(Location=cluster_6.center_2, Text=cluster_6.function, Colour=RGB(0, 0, 0))  # disabled
text_tag_13 = TextTag(Location=cluster_7.center_2, Text=cluster_7.function, Colour=RGB(0, 0, 0))  # disabled
text_tag_14 = TextTag(Location=cluster_11.center_2, Text=cluster_11.function, Colour=RGB(0, 0, 0))  # disabled
text_tag_15 = TextTag(Location=cluster_15.center_2, Text=cluster_15.function, Colour=RGB(0, 0, 0))  # disabled
text_tag_16 = TextTag(Location=cluster_9.center_2, Text=cluster_9.function, Colour=RGB(0, 0, 0))  # disabled
number_slider = Slider(3, range=0..10)  # disabled
negative = Negative(Value=number_slider)  # disabled
unit_y = UnitY(Factor=negative)  # disabled
move = Move(Geometry=cluster_13.center_2, Motion=unit_y)  # -> Geometry, Transform; disabled
text_tag_17 = TextTag(Location=move.Geometry, Text=cluster_13.function, Colour=RGB(0, 0, 0))  # disabled
file_path_2 = FilePath("C:\python\arrangement\grid6.json")
import_text_2 = ImportText(
    URI=file_path_2,
    maximum_file_size=52428800,
    selected_file_formats="application/json,application/xml,application/x-step,text/csv,text/plain")  # -> Text, Filename
direct_text_input_2 = DirectTextInput(maxlength=10000, text="Default")
panel_39 = Panel(import_text_2.Text)
panel_40 = Panel("""{
  "type": "polyline",
  "data": {
    "points": [
      [
        360.57031950518893,
        -106.10871961509143,
        0.0
      ],
      [
        369.36936589237052,
        -106.10871961509143,
        0.0
      ],
      [
        369.36936589237052,
        -97.415685834984373,
        0.0
      ],
      [
        360.57031950518893,
        -97.415685834984373,
        0.0
      ],
      [
        360.57031950518893,
        -106.10871961509143,
        0.0
      ]
    ]
  }
}""")
cluster_18 = Cluster(text="A")  # -> converted_2, converted, center_2, function
cluster_19 = Cluster(json=panel_39, text="D")  # -> converted_2, converted, center_2, function
cluster_20 = Cluster(json=panel_39, text="C")  # -> converted_2, converted, center_2, function
cluster_21 = Cluster(json=panel_39, text="G")  # -> converted_2, converted, center_2, function
cluster_22 = Cluster(json=panel_39, text="B")  # -> converted_2, converted, center_2, function
cluster_23 = Cluster(json=panel_39, text="H")  # -> converted_2, converted, center_2, function
cluster_24 = Cluster(json=panel_39, text="I")  # -> converted_2, converted, center_2, function
cluster_25 = Cluster(json=panel_39, text="M")  # -> converted_2, converted, center_2, function
cluster_26 = Cluster(json=panel_39, text="E")  # -> converted_2, converted, center_2, function
cluster_27 = Cluster(json=panel_39, text="N")  # -> converted_2, converted, center_2, function
cluster_28 = Cluster(json=panel_39, text="J")  # -> converted_2, converted, center_2, function
cluster_29 = Cluster(json=panel_39, text="L")  # -> converted_2, converted, center_2, function
cluster_30 = Cluster(json=panel_39, text="F")  # -> converted_2, converted, center_2, function
cluster_31 = Cluster(json=panel_39, text="Q")  # -> converted_2, converted, center_2, function
cluster_32 = Cluster(json=panel_39, text="K")  # -> converted_2, converted, center_2, function
cluster_33 = Cluster(json=panel_39, text="R")  # -> converted_2, converted, center_2, function
cluster_34 = Cluster(json=panel_39, text="P")  # -> converted_2, converted, center_2, function
cluster_35 = Cluster(json=panel_39, text="O")  # -> converted_2, converted, center_2, function
cluster_36 = Cluster(json=panel_39, text="S")  # -> converted_2, converted, center_2, function
cluster_37 = Cluster(json=panel_39, text="T")  # -> converted_2, converted, center_2, function
cluster_38 = Cluster(json=panel_39, text="U")  # -> converted_2, converted, center_2, function
cluster_39 = Cluster(json=panel_39, text="U")  # -> converted_2, converted, center_2, function
cluster_40 = Cluster(json=panel_39, text="W")  # -> converted_2, converted, center_2, function
cluster_41 = Cluster(json=panel_39, text="V")  # -> converted_2, converted, center_2, function
cluster_42 = Cluster(json=panel_39, text="X")  # -> converted_2, converted, center_2, function
panel_41 = Panel(cluster_18.converted)
custom_preview_18 = CustomPreview(Geometry=cluster_19.converted_2, Material=cluster_19.converted)
custom_preview_19 = CustomPreview(Geometry=cluster_30.converted_2, Material=cluster_30.converted)
custom_preview_20 = CustomPreview(Geometry=cluster_20.converted_2, Material=cluster_20.converted)
custom_preview_21 = CustomPreview(Geometry=cluster_21.converted_2, Material=cluster_21.converted)
custom_preview_22 = CustomPreview(Geometry=cluster_23.converted_2, Material=cluster_23.converted)
custom_preview_23 = CustomPreview(Geometry=cluster_24.converted_2, Material=cluster_24.converted)
custom_preview_24 = CustomPreview(Geometry=cluster_25.converted_2, Material=cluster_25.converted)
custom_preview_25 = CustomPreview(Geometry=cluster_27.converted_2, Material=cluster_27.converted)
custom_preview_26 = CustomPreview(Geometry=cluster_28.converted_2, Material=cluster_28.converted)
custom_preview_27 = CustomPreview(Geometry=cluster_29.converted_2, Material=cluster_29.converted)
custom_preview_28 = CustomPreview(Geometry=cluster_31.converted_2, Material=cluster_31.converted)
custom_preview_29 = CustomPreview(Geometry=cluster_32.converted_2, Material=cluster_32.converted)
custom_preview_30 = CustomPreview(Geometry=cluster_33.converted_2, Material=cluster_33.converted)
custom_preview_31 = CustomPreview(Geometry=cluster_34.converted_2, Material=cluster_34.converted)
custom_preview_32 = CustomPreview(Geometry=cluster_35.converted_2, Material=cluster_35.converted)
custom_preview_33 = CustomPreview(Geometry=cluster_36.converted_2, Material=cluster_36.converted)
custom_preview_34 = CustomPreview(Geometry=cluster_22.converted_2, Material=cluster_22.converted)
custom_preview_35 = CustomPreview(Geometry=cluster_37.converted_2, Material=cluster_37.converted)
custom_preview_36 = CustomPreview(Geometry=cluster_26.converted_2, Material=cluster_26.converted)
custom_preview_37 = CustomPreview(Geometry=cluster_38.converted_2, Material=cluster_38.converted)
custom_preview_38 = CustomPreview(Geometry=cluster_39.converted_2, Material=cluster_39.converted)
custom_preview_39 = CustomPreview(Geometry=cluster_18.converted_2, Material=cluster_18.converted)
custom_preview_40 = CustomPreview(Geometry=cluster_40.converted_2, Material=cluster_40.converted)
custom_preview_41 = CustomPreview(Geometry=cluster_41.converted_2, Material=cluster_41.converted)
custom_preview_42 = CustomPreview(Geometry=cluster_42.converted_2, Material=cluster_42.converted)
text_tag_18 = TextTag(Location=cluster_20.center_2, Text=cluster_20.function)
text_tag_19 = TextTag(Location=cluster_31.center_2, Text=cluster_31.function, Colour=RGB(0, 0, 0))
text_tag_20 = TextTag(Location=cluster_35.center_2, Text=cluster_35.function, Colour=RGB(0, 0, 0))
text_tag_21 = TextTag(Location=cluster_34.center_2, Text=cluster_34.function, Colour=RGB(0, 0, 0))
text_tag_22 = TextTag(Location=cluster_25.center_2, Text=cluster_25.function, Colour=RGB(0, 0, 0))
text_tag_23 = TextTag(Location=cluster_33.center_2, Text=cluster_33.function, Colour=RGB(0, 0, 0))
text_tag_24 = TextTag(Location=cluster_21.center_2, Text=cluster_21.function, Colour=RGB(0, 0, 0))
text_tag_25 = TextTag(Location=cluster_27.center_2, Text=cluster_27.function, Colour=RGB(0, 0, 0))
text_tag_26 = TextTag(Location=cluster_23.center_2, Text=cluster_23.function, Colour=RGB(0, 0, 0))
text_tag_27 = TextTag(Location=cluster_28.center_2, Text=cluster_28.function, Colour=RGB(0, 0, 0))
text_tag_28 = TextTag(Location=cluster_24.center_2, Text=cluster_24.function, Colour=RGB(0, 0, 0))
text_tag_29 = TextTag(Location=cluster_36.center_2, Text=cluster_36.function, Colour=RGB(0, 0, 0))
text_tag_30 = TextTag(Location=cluster_32.center_2, Text=cluster_32.function, Colour=RGB(0, 0, 0))
text_tag_31 = TextTag(Location=cluster_22.center_2, Text=cluster_22.function, Colour=RGB(0, 0, 0))
text_tag_32 = TextTag(Location=cluster_29.center_2, Text=cluster_29.function, Colour=RGB(0, 0, 0))
text_tag_33 = TextTag(Location=cluster_37.center_2, Text=cluster_37.function, Colour=RGB(0, 0, 0))
text_tag_34 = TextTag(Location=cluster_19.center_2, Text=cluster_19.function, Colour=RGB(0, 0, 0))
text_tag_35 = TextTag(Location=cluster_38.center_2, Text=cluster_38.function, Colour=RGB(0, 0, 0))
text_tag_36 = TextTag(Location=cluster_18.center_2, Text=cluster_18.function, Colour=RGB(0, 0, 0))
text_tag_37 = TextTag(Location=cluster_39.center_2, Text=cluster_39.function, Colour=RGB(0, 0, 0))
text_tag_38 = TextTag(Location=cluster_40.center_2, Text=cluster_40.function, Colour=RGB(0, 0, 0))
text_tag_39 = TextTag(Location=cluster_41.center_2, Text=cluster_41.function, Colour=RGB(0, 0, 0))
text_tag_40 = TextTag(Location=cluster_42.center_2, Text=cluster_42.function, Colour=RGB(0, 0, 0))
text_tag_41 = TextTag(Location=cluster_30.center_2, Text=cluster_30.function, Colour=RGB(0, 0, 0))
text_tag_42 = TextTag(Location=cluster_26.center_2, Text=cluster_26.function, Colour=RGB(0, 0, 0))
unit_y_2 = UnitY(Factor=Slider(5, range=0..10))
move_2 = Move(Geometry=cluster_22.center_2, Motion=unit_y_2)  # -> Geometry, Transform
panel_42 = Panel(""" [
          251.3241,
          -120.814,
          0
        ],
        [
          240.3797,
          -120.814,
          0
        ],
        [
          240.3797,
          -111.4316,
          0
        ],
        [
          240.3797,
          -102.0492,
          0
        ],
        [
          240.3797,
          -92.6667,
          0
        ],
        [
          240.3797,
          -82.4483,
          0
        ],
        [
          251.3241,
          -82.4483,
          0
        ],
        [
          251.3241,
          -90.2209,
          0
        ],
        [
          251.3241,
          -92.6667,
          0
        ],
        [
          251.3241,
          -102.0492,
          0
        ],
        [
          251.3241,
          -111.4316,
          0
        ],
        [
          251.3241,
          -120.814,
          0
        ]
      ]
    }
  },""")
panel_43 = Panel("""{
  "type": "polyline",
  "data": {
    "points": [
      [
        389.11931130649816,
        -81.539766955398335,
        0.0
      ],
      [
        397.6764527104126,
        -81.5397669553983,
        0.0
      ],
      [
        397.6764527104126,
        -83.048288899781568,
        0.0
      ],
      [
        416.6944375226854,
        -83.048288899781568,
        0.0
      ],
      [
        414.01669890249804,
        -86.540871855665912,
        0.0
      ],
      [
        417.19707711473234,
        -87.813023140559636,
        0.0
      ],
      [
        410.3245079983817,
        -91.865319318338351,
        0.0
      ],
      [
        389.1193113064981,
        -91.865319318338308,
        0.0
      ],
      [
        389.11931130649816,
        -81.539766955398335,
        0.0
      ]
    ]
  }
}""")  # disabled
convert_json_2 = ConvertJSON(Object=panel_42)
parse_json = ParseJSON()
parse_json_2 = ParseJSON(JSON=convert_json_2)
convert_json_3 = ConvertJSON(Object=parse_json_2)
curve_19 = Curve(<curve referenced from the Rhino model>)  # disabled
construct_json_19 = ConstructJSON(Data=curve_19)  # disabled
curve_20 = Curve(convert_json_3)
panel_44 = Panel(construct_json_19)  # disabled

# ==== cluster Cluster
json = ClusterInput()
text = ClusterInput()
parse_json = ParseJSON(JSON=json)
text_2 = Text(text)
concatenate = Concatenate(FragmentA=text_2, FragmentB="_color")
concatenate_2 = Concatenate(FragmentA=text_2, FragmentB="_function")
access_json = AccessJSON(Object=parse_json, AddressString=text_2)
access_json_2 = AccessJSON(Object=parse_json, AddressString=concatenate)
access_json_3 = AccessJSON(Object=parse_json, AddressString=concatenate_2)
convert_json = ConvertJSON(Object=access_json_2)
convert_json_2 = ConvertJSON(Object=access_json)
panel = Panel(access_json_3)
converted = ClusterOutput(convert_json)
unit_z = UnitZ(Factor="3.5")
boundary_surfaces = BoundarySurfaces(Edges=convert_json_2)
center = Center(Geometry=convert_json_2)  # -> Center, Dimension
converted_2 = ClusterOutput(convert_json_2)
extrude = Extrude(Base=boundary_surfaces, Direction=unit_z)
text_split = TextSplit(Text=panel, Separators=":")
center_2 = ClusterOutput(center.Center)
panel_2 = Panel(text_split)
dispatch = Dispatch(List=panel_2, DispatchPattern=[True, False])  # -> ListA, ListB
panel_3 = Panel(dispatch.ListB)
text_split_2 = TextSplit(Text=panel_3, Separators="}")
panel_4 = Panel(text_split_2)
function = ClusterOutput(panel_4)
