# Grasshopper definition test.3.gh (Grasshopper 1.0.7)
# plug-ins: ShapeDiverForGrasshopper

sddp = ShapeDiverDocumentPayload({AbsoluteTolerance=0, AngleTolerance=0, DistanceDisplayPrecision=0, GltfVersion="Gltf2", GrasshopperVersion="1.0.0007", InputGroups="{}", OutputGroups="{}", RelativeTolerance=0, RhinoVersion="7.37.24107.15001", UnitSystem=0, VersionCreated="1.26.0.0", VersionSaved="1.26.0.0"})

curve = Curve(<curve referenced from the Rhino model>)
construct_json = ConstructJSON(Data=curve)
panel = Panel(construct_json)

panel_2 = Panel("Q")
panel_3 = Panel("P")
panel_4 = Panel("O")
panel_5 = Panel("R")
panel_6 = Panel("S")
panel_7 = Panel("T")
panel_8 = Panel("U")
panel_10 = Panel("W")
panel_11 = Panel("V")
panel_12 = Panel("X")
panel_13 = Panel("""{
  "8A": {
    "type": "polyline",
    "data": {
      "points": [
        [
          38.74989852610799,
          115.31436984597089,
          29.6
        ],
        [
          42.74989852610799,
          115.31436984597089,
          29.6
        ],
        [
          42.74989852610799,
          119.31436984597089,
          29.6
        ],
        [
          38.74989852610799,
          119.31436984597089,
          29.6
        ],
        [
          38.74989852610799,
          115.31436984597089,
          29.6
        ]
      ]
    }
  },
  "8A_semi-outdoor": "3.7",
  "8A_indoor": "11.1",
  "8A_function": "Tree Box（可觀下層，垂直種植）",
  "8A_color": "#22C55E",
  "8B": {
    "type": "polyline",
    "data": {
      "points": [
        [
          24.388557336324617,
          126.24099526556142,
          29.6
        ],
        [
          28.388557336324617,
          126.24099526556142,
          29.6
        ],
        [
          28.388557336324617,
          130.24099526556142,
          29.6
        ],
        [
          24.388557336324617,
          130.24099526556142,
          29.6
        ],
        [
          24.388557336324617,
          126.24099526556142,
          29.6
        ]
      ]
    }
  },
  "8B_semi-outdoor": "3.7",
  "8B_indoor": "11.1",
  "8B_function": "Tree Box 擴展區 14",
  "8B_color": "#22C55E",
  "8C": {
    "type": "polyline",
    "data": {
      "points": [
        [
          16.32271395632997,
          107.76774248586884,
          29.6
        ],
        [
          35.296379917340246,
          107.76774248586884,
          29.6
        ],
        [
          35.296379917340246,
          117.25457546637398,
          29.6
        ],
        [
          16.32271395632997,
          117.25457546637398,
          29.6
        ],
        [
          16.32271395632997,
          107.76774248586884,
          29.6
        ]
      ]
    }
  },
  "8C_semi-outdoor": "0",
  "8C_indoor": "0",
  "8C_function": "芳療植栽花園",
  "8C_color": "#3B82F6",
  "8D": {
    "type": "polyline",
    "data": {
      "points": [
        [
          18.738479124969633,
          107.76774248586884,
          29.6
        ],
        [
          32.88061474870058,
          107.76774248586884,
          29.6
        ],
        [
          32.88061474870058,
          114.83881029773431,
          29.6
        ],
        [
          18.738479124969633,
          114.83881029773431,
          29.6
        ],
        [
          18.738479124969633,
          107.76774248586884,
          29.6
        ]
      ]
    }
  },
  "8D_semi-outdoor": "0",
  "8D_indoor": "3.7",
  "8D_function": "靜音陪伴室",
  "8D_color": "#3B82F6",
  "8E": {
    "type": "polyline",
    "data": {
      "points": [
        [
          27.98631842867569,
          119.6440281707606,
          29.6
        ],
        [
          40.63542906934921,
          119.6440281707606,
          29.6
        ],
        [
          40.63542906934921,
          125.96858349109738,
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""")
cluster = Cluster(json=panel_13, text="9B")  # -> extrusion, geometry, center_2, property, converted
cluster_2 = Cluster(json=panel_13, text="9D")  # -> extrusion, geometry, center_2, property, converted
cluster_3 = Cluster(json=panel_13, text="8A")  # -> extrusion, geometry, center_2, property, converted
custom_preview = CustomPreview(Geometry=cluster_3.geometry, Material=cluster_3.converted)
cluster_4 = Cluster(json=panel_13, text="8B")  # -> extrusion, geometry, center_2, property, converted
cluster_5 = Cluster(json=panel_13, text="9C")  # -> extrusion, geometry, center_2, property, converted
cluster_6 = Cluster(json=panel_13, text="8E")  # -> extrusion, geometry, center_2, property, converted
cluster_7 = Cluster(json=panel_13, text="8D")  # -> extrusion, geometry, center_2, property, converted
cluster_8 = Cluster(json=panel_13, text="9A")  # -> extrusion, geometry, center_2, property, converted
custom_preview_2 = CustomPreview(Geometry=cluster_4.geometry, Material=cluster_4.converted)
custom_preview_3 = CustomPreview(Geometry=cluster_2.extrusion, Material=cluster_2.converted)
custom_preview_4 = CustomPreview(Geometry=cluster.geometry, Material=cluster.converted)
custom_preview_5 = CustomPreview(Geometry=cluster_3.extrusion, Material=cluster_3.converted)
custom_preview_6 = CustomPreview(Geometry=cluster.extrusion, Material=cluster.converted)
custom_preview_7 = CustomPreview(Geometry=cluster_8.extrusion, Material=cluster_8.converted)
custom_preview_8 = CustomPreview(Geometry=cluster_7.geometry, Material=cluster_7.converted)
custom_preview_9 = CustomPreview(Geometry=cluster_2.geometry, Material=cluster_2.converted)
custom_preview_10 = CustomPreview(Geometry=cluster_4.extrusion, Material=cluster_4.converted)
text_tag = TextTag(Location=cluster_2.center_2, Text=cluster_2.property, Colour=RGBA(0, 0, 0, 0))
text_tag_2 = TextTag(Location=cluster.center_2, Text=cluster.property, Colour=RGBA(0, 0, 0, 0))
text_tag_3 = TextTag(Location=cluster_8.center_2, Text=cluster_8.property, Colour=RGBA(0, 0, 0, 0))
text_tag_4 = TextTag(Location=cluster_7.center_2, Text=cluster_7.property, Colour=RGBA(0, 0, 0, 0))
custom_preview_11 = CustomPreview(Geometry=cluster_5.geometry, Material=cluster_5.converted)
text_tag_5 = TextTag(Location=cluster_3.center_2, Text=cluster_3.property, Colour=RGBA(0, 0, 0, 0))
custom_preview_12 = CustomPreview(Geometry=cluster_6.extrusion, Material=cluster_6.converted)
text_tag_6 = TextTag(Location=cluster_6.center_2, Text=cluster_6.property, Colour=RGBA(0, 0, 0, 0))
text_tag_7 = TextTag(Location=cluster_4.center_2, Text=cluster_4.property, Colour=RGBA(0, 0, 0, 0))
text_tag_8 = TextTag(Location=cluster_5.center_2, Text=cluster_5.property, Colour=RGBA(0, 0, 0, 0))
custom_preview_13 = CustomPreview(Geometry=cluster_5.extrusion, Material=cluster_5.converted)
custom_preview_14 = CustomPreview(Geometry=cluster_8.geometry, Material=cluster_8.converted)
custom_preview_15 = CustomPreview(Geometry=cluster_7.extrusion, Material=cluster_7.converted)
custom_preview_16 = CustomPreview(Geometry=cluster_6.geometry, Material=cluster_6.converted)
panel_14 = Panel("11D")
cluster_9 = Cluster(json=panel_13, text="10A")  # -> extrusion, geometry, center_2, property, converted
cluster_10 = Cluster(json=panel_13, text="11A")  # -> extrusion, geometry, center_2, property, converted
cluster_11 = Cluster(json=panel_13, text="11B")  # -> extrusion, geometry, center_2, property, converted
cluster_12 = Cluster(json=panel_13, text="11C")  # -> extrusion, geometry, center_2, property, converted
cluster_13 = Cluster(json=panel_13, text="11C")  # -> extrusion, geometry, center_2, property, converted
cluster_14 = Cluster(json=panel_13, text="10D")  # -> extrusion, geometry, center_2, property, converted
cluster_15 = Cluster(json=panel_13, text="10C")  # -> extrusion, geometry, center_2, property, converted
cluster_16 = Cluster(json=panel_13, text="10B")  # -> extrusion, geometry, center_2, property, converted
custom_preview_17 = CustomPreview(Geometry=cluster_10.extrusion, Material=cluster_10.converted)
custom_preview_18 = CustomPreview(Geometry=cluster_11.extrusion, Material=cluster_11.converted)
custom_preview_19 = CustomPreview(Geometry=cluster_10.geometry, Material=cluster_10.converted)
custom_preview_20 = CustomPreview(Geometry=cluster_13.extrusion, Material=cluster_13.converted)
custom_preview_21 = CustomPreview(Geometry=cluster_13.geometry, Material=cluster_13.converted)
custom_preview_22 = CustomPreview(Geometry=cluster_12.geometry, Material=cluster_12.converted)
custom_preview_23 = CustomPreview(Geometry=cluster_14.extrusion, Material=cluster_14.converted)
custom_preview_24 = CustomPreview(Geometry=cluster_15.extrusion, Material=cluster_15.converted)
custom_preview_25 = CustomPreview(Geometry=cluster_9.extrusion, Material=cluster_9.converted)
custom_preview_26 = CustomPreview(Geometry=cluster_16.geometry, Material=cluster_16.converted)
text_tag_9 = TextTag(Location=cluster_10.center_2, Text=cluster_10.property, Colour=RGBA(0, 0, 0, 0))
text_tag_10 = TextTag(Location=cluster_11.center_2, Text=cluster_11.property, Colour=RGBA(0, 0, 0, 0))
text_tag_11 = TextTag(Location=cluster_12.center_2, Text=cluster_12.property, Colour=RGBA(0, 0, 0, 0))
text_tag_12 = TextTag(Location=cluster_13.center_2, Text=cluster_13.property, Colour=RGBA(0, 0, 0, 0))
text_tag_13 = TextTag(Location=cluster_14.center_2, Text=cluster_14.property, Colour=RGBA(0, 0, 0, 0))
custom_preview_27 = CustomPreview(Geometry=cluster_9.geometry, Material=cluster_9.converted)
text_tag_14 = TextTag(Location=cluster_9.center_2, Text=cluster_9.property, Colour=RGBA(0, 0, 0, 0))
custom_preview_28 = CustomPreview(Geometry=cluster_16.extrusion, Material=cluster_16.converted)
custom_preview_29 = CustomPreview(Geometry=cluster_15.geometry, Material=cluster_15.converted)
text_tag_15 = TextTag(Location=cluster_15.center_2, Text=cluster_15.property, Colour=RGBA(0, 0, 0, 0))
custom_preview_30 = CustomPreview(Geometry=cluster_14.geometry, Material=cluster_14.converted)
custom_preview_31 = CustomPreview(Geometry=cluster_12.extrusion, Material=cluster_12.converted)
text_tag_16 = TextTag(Location=cluster_16.center_2, Text=cluster_16.property, Colour=RGBA(0, 0, 0, 0))
cluster_17 = Cluster(json=panel_13, text="12C")  # -> extrusion, geometry, center_2, property, converted
cluster_18 = Cluster(json=panel_13, text="12A")  # -> extrusion, geometry, center_2, property, converted
cluster_19 = Cluster(json=panel_13, text="13A")  # -> extrusion, geometry, center_2, property, converted
cluster_20 = Cluster(json=panel_13, text="13D")  # -> extrusion, geometry, center_2, property, converted
cluster_21 = Cluster(json=panel_13, text="13B")  # -> extrusion, geometry, center_2, property, converted
cluster_22 = Cluster(json=panel_13, text="13C")  # -> extrusion, geometry, center_2, property, converted
cluster_23 = Cluster(json=panel_13, text="12B")  # -> extrusion, geometry, center_2, property, converted
cluster_24 = Cluster(json=panel_13, text="12D")  # -> extrusion, geometry, center_2, property, converted
custom_preview_32 = CustomPreview(Geometry=cluster_17.extrusion, Material=cluster_17.converted)
custom_preview_33 = CustomPreview(Geometry=cluster_18.extrusion, Material=cluster_18.converted)
custom_preview_34 = CustomPreview(Geometry=cluster_21.extrusion, Material=cluster_21.converted)
custom_preview_35 = CustomPreview(Geometry=cluster_19.extrusion, Material=cluster_19.converted)
custom_preview_36 = CustomPreview(Geometry=cluster_18.geometry, Material=cluster_18.converted)
custom_preview_37 = CustomPreview(Geometry=cluster_20.extrusion, Material=cluster_20.converted)
custom_preview_38 = CustomPreview(Geometry=cluster_20.geometry, Material=cluster_20.converted)
custom_preview_39 = CustomPreview(Geometry=cluster_22.extrusion, Material=cluster_22.converted)
custom_preview_40 = CustomPreview(Geometry=cluster_24.extrusion, Material=cluster_24.converted)
custom_preview_41 = CustomPreview(Geometry=cluster_22.geometry, Material=cluster_22.converted)
custom_preview_42 = CustomPreview(Geometry=cluster_17.geometry, Material=cluster_17.converted)
custom_preview_43 = CustomPreview(Geometry=cluster_23.extrusion, Material=cluster_23.converted)
custom_preview_44 = CustomPreview(Geometry=cluster_19.geometry, Material=cluster_19.converted)
custom_preview_45 = CustomPreview(Geometry=cluster_24.geometry, Material=cluster_24.converted)
custom_preview_46 = CustomPreview(Geometry=cluster_21.geometry, Material=cluster_21.converted)
custom_preview_47 = CustomPreview(Geometry=cluster_23.geometry, Material=cluster_23.converted)
text_tag_17 = TextTag(Location=cluster_23.center_2, Text=cluster_23.property, Colour=RGBA(0, 0, 0, 0))
text_tag_18 = TextTag(Location=cluster_19.center_2, Text=cluster_19.property, Colour=RGBA(0, 0, 0, 0))
text_tag_19 = TextTag(Location=cluster_24.center_2, Text=cluster_24.property, Colour=RGBA(0, 0, 0, 0))
text_tag_20 = TextTag(Location=cluster_21.center_2, Text=cluster_21.property, Colour=RGBA(0, 0, 0, 0))
text_tag_21 = TextTag(Location=cluster_22.center_2, Text=cluster_22.property, Colour=RGBA(0, 0, 0, 0))
text_tag_22 = TextTag(Location=cluster_20.center_2, Text=cluster_20.property, Colour=RGBA(0, 0, 0, 0))
text_tag_23 = TextTag(Location=cluster_18.center_2, Text=cluster_18.property, Colour=RGBA(0, 0, 0, 0))
text_tag_24 = TextTag(Location=cluster_17.center_2, Text=cluster_17.property, Colour=RGBA(0, 0, 0, 0))

# ==== cluster Cluster
sddp = ShapeDiverDocumentPayload({AbsoluteTolerance=0, AngleTolerance=0, DistanceDisplayPrecision=0, GltfVersion="Gltf2", GrasshopperVersion="1.0.0007", InputGroups="{}", OutputGroups="{}", RelativeTolerance=0, RhinoVersion="7.37.24107.15001", UnitSystem=0, VersionCreated="1.26.0.0", VersionSaved="1.26.0.0"})
text = ClusterInput()
json = ClusterInput()
parse_json = ParseJSON(JSON=json)
text_2 = Text(text)
concatenate = Concatenate(FragmentA=text_2, FragmentB="_indoor")
concatenate_2 = Concatenate(FragmentA=text_2, FragmentB="_semi-outdoor")
concatenate_3 = Concatenate(FragmentA=text_2, FragmentB="_function")
concatenate_4 = Concatenate(FragmentA=text_2, FragmentB="_color")
access_json = AccessJSON(Object=parse_json, AddressString=concatenate_3)
access_json_2 = AccessJSON(Object=parse_json, AddressString=concatenate_2)
access_json_3 = AccessJSON(Object=parse_json, AddressString=concatenate)
access_json_4 = AccessJSON(Object=parse_json, AddressString=text_2)
access_json_5 = AccessJSON(Object=parse_json, AddressString=concatenate_4)
convert_json = ConvertJSON(Object=access_json_4)
unit_z = UnitZ(Factor=access_json_2)
property = ClusterOutput(access_json)
unit_z_2 = UnitZ(Factor=access_json_3)
convert_json_2 = ConvertJSON(Object=access_json_5)
boundary_surfaces = BoundarySurfaces(Edges=convert_json)
center = Center(Geometry=convert_json)  # -> Center, Dimension
extrude = Extrude(Base=boundary_surfaces, Direction=unit_z_2)
move = Move(Geometry=boundary_surfaces, Motion=unit_z)  # -> Geometry, Transform
panel = Panel(access_json_3)
extrusion = ClusterOutput(extrude)
converted = ClusterOutput(convert_json_2)
geometry = ClusterOutput(move.Geometry)
center_2 = ClusterOutput(center.Center)
